# Grasshopper definition test_gh_canvas.gh (Grasshopper 1.0.8)

crv = Curve(<curve referenced from the Rhino model>)
end = EndPoints(Curve=crv)  # -> Start, End
brep = Brep([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])
pt = Point(Point(0.9897508519, -5.322338418, 3))
vec2pt = Vector2Pt(PointA=end.Start, PointB=end.End, Unitize=False)  # -> Vector, Length
end_2 = EndPoints(Curve=<geometry referenced from the Rhino model>)  # -> Start, End
multiplication = Multiplication(A=vec2pt.Vector, B=5)
vec2pt_2 = Vector2Pt(PointA=end_2.Start, PointB=end_2.End, Unitize=False)  # -> Vector, Length
multiplication_2 = Multiplication(A=multiplication, B=1000)
pt_2 = Point(<point referenced from the Rhino model>)
brep_2 = Brep([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])
area = Area(Geometry=brep_2)  # -> Area, Centroid
geo = Geometry([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])
colour = ColourPicker(PickedColour=RGB(255, 225, 0))

# ---- group: create and visualise applied moment vector
number_slider = Slider(2400, range=0..10000)
crv_2 = Curve(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)
vec = Vector(crv_2)
unit = UnitVector(Vector=vec)
multiplication_3 = Multiplication(A=unit, B=number_slider)
division = Division(A=number_slider, B=1000)
multiplication_4 = Multiplication(A=vec, B=Slider(0.1, range=0..0.1))
concat = Concatenate(FragmentA=division, FragmentB=" [kN*m]")
vdis = VectorDisplay(Anchor=pt_2, Vector=multiplication_4)
tag = TextTag(Location=pt_2, Text=concat, Colour=colour)

# ----
amoments = AreaMoments(Geometry=brep_2)  # -> Area, Centroid, Inertia, Secondary, Gyration
scsy_cpy = ScriptSyncCpython(
    select_file=Button(),
    package_2_reload="joint_calc",
    brep_faces=brep_2,
    moment_vector=multiplication_3,
    bool_val=Toggle(False),
    rotation_center=pt_2,
    axial_force=multiplication_2,
    screw_axis=vec2pt_2.Vector)  # -> stdout, vectors, anchors, stress_distributions, sigma_maxs; inputs select_file: Boolean, package_2_reload: String, brep_faces: list of Brep, moment_vector: Vector3d, rotation_center: Point3d, axial_force: Vector3d, screw_axis: Vector3d
#   port select_file: Connect a button to open a file dialog to select a cpython file to run.
#   port package_2_reload: Pass a list with the name of the custom packages you want to reload. This function is useful if you are developing a i.e. PyPI package and you want to reload the submodules after you modified something. The function will reload the package and all its submodules. If you want to reload the package and all its submodules, just pass the package name. If you want to reload only a submodule, pass the package name and the submodule name separated by a dot. If you want to reload multiple submodules, pass the package
#   port brep_faces: A generic x input.
#   port stdout: The redirected standard output of the component scriptsync.
#   port vectors: Generic example output of the component
# ---------- scsy_cpy: Python ----------
import System
import System.Drawing
import sys
import os
import time

import contextlib
import io

import typing

import abc
import socket
import threading
import queue
import json

import importlib
import sys

import traceback

import Rhino
import rhinoscriptsyntax as rs
import Grasshopper
import Grasshopper as gh
from Grasshopper.Kernel import GH_RuntimeMessageLevel as RML
import ghpythonlib.treehelpers as th


def add_button(self,
    nickname: str,
    indx: int,
    X_param_coord: float,
    Y_param_coord: float,
    X_offset: int=100
    ) -> None:
    """
        Adds a button to the component input

        :param nickname: the nickname of the button
        :param indx: the index of the input parameter
        :param X_param_coord: the x coordinate of the input parameter
        :param Y_param_coord: the y coordinate of the input parameter
        :param X_offset: the offset of the button from the input parameter
    """
    param = ghenv.Component.Params.Input[indx]
    if param.SourceCount == 0:
        button = Grasshopper.Kernel.Special.GH_ButtonObject()
        button.NickName = ""
        button.Description = ""
        button.CreateAttributes()
        button.Attributes.Pivot = System.Drawing.PointF(
            X_param_coord - (button.Attributes.Bounds.Width) - X_offset,
            Y_param_coord - (button.Attributes.Bounds.Height / 2 - 0.1)
            )
        button.Attributes.ExpireLayout()
        Grasshopper.Instances.ActiveCanvas.Document.AddObject(button, False)
        ghenv.Component.Params.Input[indx].AddSource(button)

class GHThread(threading.Thread, metaclass=abc.ABCMeta):
    """
        A base class for Grasshopper threads.
    """
    def __init__(self, name : str):
        super().__init__(name=name, daemon=False)
        self._component_on_canvas = True
        self._component_enabled = True

    @abc.abstractmethod
    def run(self):
        """ Run the thread. """
        pass

    def _check_if_component_on_canvas(self):
        """ Check if the component is on canvas from thread. """
        def __check_if_component_on_canvas():
            if ghenv.Component.OnPingDocument() is None:
                self._component_on_canvas = False
                return False
            else:
                self._component_on_canvas = True
                return True
        action = System.Action(__check_if_component_on_canvas)
        Rhino.RhinoApp.InvokeOnUiThread(action)

    def _check_if_component_enabled(self):
        """ Check if the component is enabled from thread. """
        def __check_if_component_enabled():
            if ghenv.Component.Locked:
                self._component_enabled = False
            else:
                self._component_enabled = True
        action = System.Action(__check_if_component_enabled)
        Rhino.RhinoApp.InvokeOnUiThread(action)

    def expire_component_solution(self):
        """ Fire the recalculation of the component solution from thread. """
        def __expire_component_solution():
            ghenv.Component.Params.Output[0].ClearData()  # clear the output
            ghenv.Component.ExpireSolution(True)  # expire the component
        action = System.Action(__expire_component_solution)
        Rhino.RhinoApp.InvokeOnUiThread(action)

    def clear_component(self):
        """ Clear the component from thread. """
        def __clear_component():
            ghenv.Component.ClearData()
        action = System.Action(__clear_component)
        Rhino.RhinoApp.InvokeOnUiThread(action)

    def add_runtime_warning(self, exception : str):
        """ Add a warning tab to the component from main thread. """
        action = System.Action(
            lambda: ghenv.Component.AddRuntimeMessage(RML.Warning, exception)
        )
        Rhino.RhinoApp.InvokeOnUiThread(action)

    def add_runtime_error(self, exception : str):
        """ Add an error tab to the component from main thread. """
        action = System.Action(
            lambda: ghenv.Component.AddRuntimeMessage(RML.Error, exception)
        )
        Rhino.RhinoApp.InvokeOnUiThread(action)

    def add_runtime_remark(self, exception : str):
        """ Add a blank tab to the component from main thread. """
        action = System.Action(
            lambda: ghenv.Component.AddRuntimeMessage(RML.Remark, exception)
        )
        Rhino.RhinoApp.InvokeOnUiThread(action)

    @property
    def component_enabled(self):
        self._check_if_component_enabled()
        return self._component_enabled

    @property
    def component_on_canvas(self):
        self._check_if_component_on_canvas()
        return self._component_on_canvas

class ClientThread(GHThread):
    """
    A thread to connect to the VSCode server.
    """
    def __init__(self, vscode_server_ip: str, vscode_server_port: int, name: str,
                 queue_msg: queue.Queue = None, lock_queue_msg: threading.Lock = None,
                 event_fire_msg: threading.Event = None):
        super().__init__(name=name)
        self.vscode_server_ip = vscode_server_ip
        self.vscode_server_port = vscode_server_port
        self.is_connected = False
        self.connect_refresh_rate = 1  # seconds
        self.queue_msg = queue_msg
        self.lock_queue_msg = lock_queue_msg
        self.event_fire_msg = event_fire_msg
        self.client_socket = socket.socket(socket.AF_INET, socket.SOCK_STREAM)

    def run(self):
        """ Run the thread. Send the message to the vscode server."""
        while self.component_on_canvas and self.component_enabled:
            try:
                if not self.is_connected:
                    self.connect_to_vscode_server()
                    self.clear_component()
                    self.expire_component_solution()
                    continue

                self.event_fire_msg.wait()
                self.send_message_from_queue()

            except Exception as e:
                self.add_runtime_warning(f"script-sync::Unkown error from run: {str(e)}")
                self.is_connected = False
                self.client_socket = socket.socket(socket.AF_INET, socket.SOCK_STREAM)

        self.client_socket.close()

    def send_message_from_queue(self):
        with self.lock_queue_msg:
            if self.queue_msg and not self.queue_msg.empty():
                msg = self.queue_msg.get()
                self.queue_msg.task_done()
                self.event_fire_msg.set()
                self.event_fire_msg.clear()
                self.client_socket.send(msg)

    def connect_to_vscode_server(self):
        """ Connect to the VSCode server. """
        while self.component_on_canvas and not self.is_connected:
            try:
                self.client_socket.send(b"")
                self.is_connected = True
            except socket.error:
                try:
                    self.client_socket.connect((self.vscode_server_ip, self.vscode_server_port))
                    self.is_connected = True
                except (ConnectionRefusedError, ConnectionResetError, socket.error) as e:
                    self.handle_connection_error(e)
            finally:
                time.sleep(self.connect_refresh_rate)

    def handle_connection_error(self, e):
        error_messages = {
            ConnectionRefusedError: "script-sync::Not connected to vscode",
            ConnectionResetError: "script-sync::Connection was forcibly closed by the vscode",
            socket.error: f"script-sync::Error connecting to the vscode: {str(e)}, have you tried to press Shift+F4 on VSCode?"
        }
        self.add_runtime_warning(error_messages[type(e)])
        self.is_connected = False if type(e) != socket.error or e.winerror != 10056 else True

class FileChangedThread(GHThread):
    """
        A thread to check if the file has changed on disk.
    """
    def __init__(self,
                path : str,
                name : str
                ):
        super().__init__(name=name)
        self.path = path
        self.refresh_rate = 1000  # milliseconds
        self._on_file_changed = threading.Event()

    def run(self):
        """
            Check if the file has changed on disk.
        """
        last_modified = os.path.getmtime(self.path)
        while self.component_on_canvas and not self._on_file_changed.is_set():
            System.Threading.Thread.Sleep(self.refresh_rate)
            last_modified = self.is_file_modified(last_modified)
        self._on_file_changed.clear()
        return

    def stop(self):
        """ Stop the thread. """
        self._on_file_changed.set()

    def is_file_modified(self, last_modified):
        current_modified = os.path.getmtime(self.path)
        if current_modified != last_modified:
            self.expire_component_solution()
            return current_modified
        return last_modified

class ScriptSyncCPy(Grasshopper.Kernel.GH_ScriptInstance):
    def __init__(self):
        self._var_output = []

        self.is_success = False

        self.client_thread_name : str = f"script-sync-client-thread::{ghenv.Component.InstanceGuid}"
        self.vscode_server_ip = "127.0.0.1"
        self.vscode_server_port = 58260
        self.stdout = None
        self.queue_msg = queue.Queue()
        self.queue_msg_lock = threading.Lock()
        self.event_fire_msg = threading.Event()

        self.filechanged_thread_name : str = f"script-sync-fileChanged-thread::{ghenv.Component.InstanceGuid}"
        self.__path_name_table_value = "script-sync::" + "path::" + str(ghenv.Component.InstanceGuid)
        if self.path is None:
            ghenv.Component.Message = "select-script"
        else:
            ghenv.Component.Message = os.path.basename(self.path)

        ghenv.Component.ExpireSolution(True)
        ghenv.Component.Attributes.PerformLayout()
        params = getattr(ghenv.Component.Params, "Input")
        for j in range(len(params)):
            X_cord = params[j].Attributes.Pivot.X
            Y_cord = params[j].Attributes.InputGrip.Y
            if params[j].Name == "select_file":
                add_button(self, "Select file", j, X_cord, Y_cord)

    def RemovedFromDocument(self, doc):
        """ Remove the component from the document. """
        if self.client_thread_name in [t.name for t in threading.enumerate()]:
            client_thread = [t for t in threading.enumerate() if t.name == self.client_thread_name][0]
            client_thread.join()
        if self.filechanged_thread_name in [t.name for t in threading.enumerate()]:
            filechanged_thread = [t for t in threading.enumerate() if t.name == self.filechanged_thread_name][0]
            filechanged_thread.join()
        if self.queue_msg is not None:
            self.queue_msg.join()
        if self.queue_msg_lock is not None:
            self.queue_msg_lock.release()
        if self.event_fire_msg is not None:
            self.event_fire_msg.clear()

        # clear the path from the table view
        del self.path

    def init_script_path(self, select_file : bool = False) -> None:
        """
            Check if the button is pressed and load/change path script.
            
            :param select_file: A boolean of the button
        """
        # check if button is pressed
        if select_file is True:
            filename = rs.OpenFileName("Open", "Python Files (*.py)|*.py||")
            if filename is None:
                raise Exception("script-sync::No file selected")
            self.path = filename

        if self.path is None:
            ghenv.Component.AddRuntimeMessage(RML.Remark, "script-sync::No file selected")
            return
        else:
            # if file is in table view before
            if not os.path.exists(self.path):
                raise Exception("script-sync::File does not exist")

    def reload_all_modules(self, directory):
        for filename in os.listdir(directory):
            if filename.endswith('.py') and filename != '__init__.py':
                module_name = filename[:-3]  # remove '.py' from filename
                if module_name in sys.modules:
                    importlib.reload(sys.modules[module_name])

    def safe_exec(self, path, globals, locals, package_2_reload):
        """
            Execute Python3 code safely. It redirects the output of the code
            to a string buffer 'stdout' to output to the GH component param.
            It is send to the vscode server.
            
            :param path: The path of the file to execute.
            :param globals: The globals dictionary.
            :param locals: The locals dictionary.
            :param package_2_reload: The list of packages to reload, this is used for custom packages developement.
            installed on the system via an editable pip installation for example.
        """
        output_buffer = io.StringIO()
        try:
            sys.stdout = output_buffer
            with open(path, 'r') as f:
                # reload the specifyed packages
                if package_2_reload is not None:
                    if package_2_reload.__len__() != 0:
                        for key in list(sys.modules.keys()):
                            if package_2_reload in key:
                                # check that the package must have the attribute __file__ (to avoid reloading pyd)
                                if hasattr(sys.modules[key], '__file__'):
                                    importlib.reload(sys.modules[key])

                # add the path and sub directories to  the sys path
                path_dir = os.path.dirname(path)
                sub_dirs = []
                for root, dirs, files in os.walk(path_dir):
                    for d in dirs:
                        sub_dirs.append(os.path.join(root, d))
                sys.path.extend([path_dir] + sub_dirs)

                # reload all the modules also of the sub directories
                for root, dirs, files in os.walk(path_dir):
                    for d in dirs:
                        self.reload_all_modules(os.path.join(root, d))
                self.reload_all_modules(path_dir)

                # refresh the python interpreter
                importlib.invalidate_caches()

                # parse the code
                code = compile(f.read(), path, 'exec')
                # output = io.StringIO()

                # empty the queue and event
                with self.queue_msg_lock:
                    while not self.queue_msg.empty():
                        self.queue_msg.get()
                        self.queue_msg.task_done()
                self.event_fire_msg.clear()

                # clear all the locals dictionary to avoid that the output variables stick between the component
                # executions when it is recomputed
                outparam = ghenv.Component.Params.Output
                outparam_names = [p.NickName for p in outparam]
                for outp in outparam_names:
                    if outp in locals.keys():
                        del locals[outp]

                # execute the code
                with contextlib.redirect_stdout(output_buffer):
                    exec(code, globals, locals)
                locals["stdout"] = output_buffer.getvalue()

                # send the msg to the vscode server
                msg_json = json.dumps({"script_path": path,
                                       "guid": str(ghenv.Component.InstanceGuid),
                                       "msg": output_buffer.getvalue()})
                msg_json = msg_json.encode('utf-8')
                self.queue_msg.put(msg_json)
                self.event_fire_msg.set()

                # pass the script variables to the GH component outputs
                for outp in outparam_names:
                    if outp in locals.keys():
                        self._var_output.append(locals[outp])
                    else:
                        self._var_output.append(None)
            return locals

        except Exception as e:
            # Get the traceback
            tb = traceback.format_exc()

            # Send the error message to the vscode server
            err_json = json.dumps({
                "script_path": path,
                "guid": str(ghenv.Component.InstanceGuid),
                "msg": "err:" + str(e),
                "traceback": tb  # Include the traceback in the JSON
            })
            err_json = err_json.encode('utf-8')
            self.queue_msg.put(err_json)
            self.event_fire_msg.set()

            # FIXME: this is not working the retrival of the previous messages
            # for debugging purposes we include the prints before and the error message
            err_msg_header = f"script-sync::Error in the code file {path}"
            err_msg_sep = ">" * 30
            err_msg = f"script-sync::Error in the code: {str(e)}\n{tb}"
            prints_before_err_msg = output_buffer.getvalue()
            prints_before_msg = prints_before_err_msg.split("\n")

            err_msg = err_msg_header + \
                f"\n{err_msg_sep}\n" + "Error msg:" + f"\n{err_msg_sep}\n" + \
                err_msg
                # f"\n{err_msg_sep}\n" + "Preavious prints before error:" + f"\n{err_msg_sep}\n" + \
                # "\n".join(prints_before_msg[:-1])

            raise Exception(err_msg)
        
        finally:
            sys.stdout = sys.__stdout__
            output_buffer.close()

    def RunScript(self,
            select_file: bool,
            package_2_reload: str,
            brep_faces: System.Collections.Generic.List[Rhino.Geometry.Brep],
            moment_vector: Rhino.Geometry.Vector3d,
            bool_val,
            rotation_center: Rhino.Geometry.Point3d,
            axial_force: Rhino.Geometry.Vector3d,
            screw_axis: Rhino.Geometry.Vector3d):
        """ This method is called whenever the component has to be recalculated it's the solve main instance. """
        self.is_success = False

        # set up the tcp client to connect to the vscode server
        _ = [print(t.name) for t in threading.enumerate()]
        if self.client_thread_name not in [t.name for t in threading.enumerate()]:
            ClientThread(self.vscode_server_ip,
                        self.vscode_server_port,
                        self.client_thread_name,
                        self.queue_msg,
                        self.queue_msg_lock,
                        self.event_fire_msg
                        ).start()
        
        # set the path if button is pressed
        self.init_script_path(select_file)

        # file change listener thread
        if self.filechanged_thread_name not in [t.name for t in threading.enumerate()]:
            FileChangedThread(self.path,
                            self.filechanged_thread_name
                            ).start()

    

        # add to the globals all the input parameters of the component (the locals)
        globals().update(locals())

        # execute the external script
        if self.path is not None:
            res = self.safe_exec(self.path, None, globals(), package_2_reload)
            self.is_success = True
        
        return

    def AfterRunScript(self):
        """
            This method is called as soon as the component has finished
            its calculation. It is used to load the GHComponent outputs
            with the values created in the script.
        """
        def _is_first_lvl_nested_iterable(lst : typing.List) -> bool:
            """
            Detect if the first level of a list is nested. 
            e.g. 
                [1, 2, 3, 4, [5,6]] --> return value: False
                [[1, 2], [3, 4]] --> return value: True

            :param lst: The list to check
            :return: True if the first level is nested, False otherwise
            """
            return all(isinstance(item, list) for item in lst)
        
        def _nesting_level(container: typing.Union[typing.List, typing.Tuple]) -> int:
            """ Get the level of nesting of a list or tuple. """
            if isinstance(container, (list, tuple)):
                return 1 + max(_nesting_level(item) for item in container)
            else:
                return 0

        def _force_nesting_list(lst : typing.List) -> list:
            """
                Transform a list with nested lists into a list of lists.
                
                Example:
                >>> list_C = [
                                1, 2, 3, 4,  # {0;0}
                                [5, 6],      # {1;0}
                                [7, 8]       # {2;0}
                            ]
                >>> _force_nesting_list(list_C)
                [[1, 2, 3, 4], [5, 6], [7, 8]]

                :param lst: The list to transform
                :return: The transformed list
            """
            transformed_list = []
            sublist = []
            
            for item in lst:
                if isinstance(item, list):
                    if sublist:
                        transformed_list.append(sublist)
                        sublist = []
                    transformed_list.append(item)
                else:
                    sublist.append(item)
            if sublist:
                transformed_list.append(sublist)
            
            return transformed_list

        def _get_list_shape(lst : typing.List) -> tuple:
            """
                Get the shape of a list of lists.
                
                Example:
                >>> list_A = [
                                [
                                    [1, 2],  # {0;0}
                                    [3, 4]   # {0;1}
                                ],
                                [
                                    [5, 6],  # {1;0}
                                    [7, 8]   # {1;1}
                                ]
                            ]
                >>> _get_list_shape(list_A)
                (2, 2, 2)

                :param lst: The list to get the shape of
                :return: The shape of the list
            """
            if isinstance(lst, list):
                if len(lst) == 0:
                    return (0,)
                return (len(lst),) + _get_list_shape(lst[0])
            else:
                return ()

        if not self.is_success:
            return

        outparam = [p for p in ghenv.Component.Params.Output]
        outparam_names = [p.NickName for p in outparam]

        for idx, outp in enumerate(outparam):
            # case 1: nested lists
            if type(self._var_output[idx]) == tuple or type(self._var_output[idx]) == list:
                self._var_output[idx] = th.list_to_tree(self._var_output[idx])


                # ghenv.Component.Params.Output[idx].VolatileData.Clear()

                # list_nest_lvl = _nesting_level(self._var_output[idx])

                # # case *: force the nesting of the list if it is nested but also with single elements on the first level (e.g. [1, 2, [3, 4]] --> [[1, 2], [3, 4]])
                # if list_nest_lvl >= 2 and _is_first_lvl_nested_iterable(self._var_output[idx]) is False:
                #     self._var_output[idx] = _force_nesting_list(self._var_output[idx])

                # # case 1.A: <<< DESCRIPTION >>>
                # if list_nest_lvl == 1:
                #     ghenv.Component.Params.Output[idx].AddVolatileDataList(gh.Kernel.Data.GH_Path(0), self._var_output[idx])
                # # case 1.B: <<< DESCRIPTION >>>
                # elif list_nest_lvl == 2:
                #     nbr_tuples_aka_branches = len(self._var_output[idx])
                #     for i in range(nbr_tuples_aka_branches):
                #         ghenv.Component.Params.Output[idx].AddVolatileDataList(gh.Kernel.Data.GH_Path(i), self._var_output[idx][i])
                # # case 1.C: <<< DESCRIPTION >>>
                # elif list_nest_lvl > 2:


                #     # TODO: to be solved
                #     # >>>>>>>>>>>>>>>>>>>>>>>>>
                #     list_shape = _get_list_shape(self._var_output[idx])
                #     # Create a recursive function to add the volatile data


                #     def add_volatile_data_recursive(output_param, data, path):
                #         if isinstance(data, list):
                #             for i, item in enumerate(data):
                #                 new_path = gh.Kernel.Data.GH_Path(path)
                #                 new_path = new_path.AppendElement(i)
                #                 add_volatile_data_recursive(output_param, item, new_path)
                #         else:
                #             output_param.AddVolatileData(path, 0, data)  # Use index 0 for leaf nodes

                #     # Example usage within your existing code
                #     nbr_tuples_aka_branches = len(self._var_output[idx])
                #     for i in range(nbr_tuples_aka_branches):
                #         path = gh.Kernel.Data.GH_Path(i)
                #         add_volatile_data_recursive(ghenv.Component.Params.Output[idx], self._var_output[idx][i], path)
                #     # <<<<<<<<<<<<<<<<<<<<<<<<<
            # else:
            # case 2: single values
            ghenv.Component.Params.Output[idx].VolatileData.Clear()
            # case 2.A: the user is returning a Grasshopper.DataTree[System.Object] via the utility ghpythonlib.treehelpers
            # e.g.: list_tree = th.list_to_tree(list_A)
            # this will be conserve the structure
            if type(self._var_output[idx]) == Grasshopper.DataTree[System.Object]:
                # self._var_output[idx].SimplifyPaths()
                branch_count = self._var_output[idx].BranchCount
                for i in range(branch_count):
                    path = self._var_output[idx].Paths[i]
                    data = self._var_output[idx].Branch(path)
                    ghenv.Component.Params.Output[idx].AddVolatileDataList(path, data)
            # case 2.B: simple single value
            else:
                ghenv.Component.Params.Output[idx].AddVolatileData(gh.Kernel.Data.GH_Path(0), 0, self._var_output[idx])
        
        self._var_output.clear()

    @property
    def path(self):
        """ Get the path of the file from the table view to be sticking between the sessions. """
        table_value = ghenv.Component.OnPingDocument().ValueTable.GetValue(
            self.__path_name_table_value, "not_found"
        )
        if table_value != "not_found":
            return table_value
        else:
            return None

    @path.setter
    def path(self, path : str):
        """ Set the path of the file to the table view to be sticking between the sessions. """
        ghenv.Component.OnPingDocument().ValueTable.SetValue(self.__path_name_table_value, path)

        script_name = os.path.basename(path)
        ghenv.Component.Message = f"{script_name}"

        if self.filechanged_thread_name in [t.name for t in threading.enumerate()]:
            _ = [t for t in threading.enumerate() if t.name == self.filechanged_thread_name][0].stop()

    @path.deleter
    def path(self):
        """ Delete the path of the file from the table view if the object is erased. """
        ghenv.Component.OnPingDocument().ValueTable.DeleteValue(self.__path_name_table_value)
# ---------- end scsy_cpy ----------
debrep = DeconstructBrep(Brep=brep_2)  # -> Faces, Edges, Vertices
rwjc_moment_calculator = RWJCRWJC_moment_calculator(brep_faces=brep_2, moment_vector=multiplication_3, rotation_center=pt_2)  # -> resultant_vectors, anchors, stress_distribution, sigma_maxs; inputs brep_faces: list of Brep, moment_vector: Vector3d, rotation_center: Point3d
#   port brep_faces: The brep faces of the joint
#   port moment_vector: The moment vector applied to the joint.
#   port rotation_center: The point around which the moment vector is applied.
#   port resultant_vectors: The resultant forces on the joint faces.
#   port anchors: The anchor points for the resultant forces.
#   port stress_distribution: The stress distribution on the joint faces.
#   port sigma_maxs: The maximum stress values on the respective joint faces.
# ---------- rwjc_moment_calculator: Python ----------
"""computes the stresses in a roundwood joint created by a moment"""
import Rhino
import System

from ghpythonlib.componentbase import executingcomponent as component

from joint_calc import face, joint, stress_field, geometry

class RWJCMomentCalculator(component):
    def RunScript(self,
            brep_faces: System.Collections.Generic.List[Rhino.Geometry.Brep],
            moment_vector: Rhino.Geometry.Vector3d,
            rotation_center: Rhino.Geometry.Point3d):
        vectors = []
        anchors = []

        joint_faces = []
        for i, brep_face in enumerate(brep_faces):
            face_area = Rhino.Geometry.AreaMassProperties.Compute(brep_face).Area
            joint_face = face.JointFace(
                id=i,
                parent_joint_id=0,
                area=face_area,
                normal=geometry.Vector.from_vector_3d(brep_face.Faces[0].NormalAt(0.5, 0.5)),
                brep_surface=brep_face,
            )
            joint_faces.append(joint_face)

            vectors.append(
                Rhino.Geometry.Vector3d(
                    joint_face.normal.x / 10, joint_face.normal.y / 10, joint_face.normal.z / 10
                )
            )

        my_joint = joint.Joint(name="Joint1", faces=joint_faces, moment_weights=None)

        stress_computer = stress_field.StressFieldComputer(
            moment=geometry.Vector(
                moment_vector.X,
                moment_vector.Y,
                moment_vector.Z,
            ),
            rotation_point=geometry.Point(
                rotation_center.X,
                rotation_center.Y,
                rotation_center.Z, 
            ),
            joint=my_joint,
        )
        stress_computer.compute_stress_field()
        print(
            f"Total tensile component: {round(stress_computer.total_tensile_component) / 1000} kN"
        )

        for joint_face in my_joint.faces:
            anchors.append(
                Rhino.Geometry.Point3d(
                    joint_face.resultant_location.x,
                    joint_face.resultant_location.y,
                    joint_face.resultant_location.z,
                )
            )
        stress_distributions = [joint_face.stress_distribution for joint_face in my_joint.faces]
        sigma_maxs = [
            f"sigma_max = {round(joint_face.max_stress / 1e6, 2)} MPa"
            for joint_face in my_joint.faces
        ]
        
        return [vectors, anchors, stress_distributions, sigma_maxs]
# ---------- end rwjc_moment_calculator ----------
evalsrf = EvaluateSurface(Surface=brep_2, Point=amoments.Centroid)  # -> Point, Normal, UDirection, VDirection, Frame
brep_3 = Brep(scsy_cpy.stress_distributions)
item = ListItem(List=brep_2, Index=Slider(0, range=0..10), Wrap=True)
multiplication_5 = Multiplication(A=evalsrf.Normal, B=0.1)
panel = Panel(scsy_cpy.stdout)
pt_3 = Point(evalsrf.Point)
vdis_2 = VectorDisplay(Anchor=amoments.Centroid, Vector=multiplication_5)
vdis_3 = VectorDisplay(Anchor=rwjc_moment_calculator.anchors, Vector=rwjc_moment_calculator.resultant_vectors)
tag_2 = TextTag(Location=rwjc_moment_calculator.anchors, Text=rwjc_moment_calculator.sigma_maxs, Colour=colour)
